# Grasshopper definition S2.3-Voronoi_script.gh (Grasshopper 1.0.7)
# plug-ins: LunchBox, Weaverbird

pt = Point(<point referenced from the Rhino model>)
get_point = GetPoint(pt, AtLeast=1, AtMost=1, Prompt="Input second point from origin to create box", Realtime=True)
get_integer = GetInteger(
    Slider(533, range=1..1000),
    AtLeast=1,
    AtMost=1,
    Maximum=2147483647,
    Minimum=-2147483648,
    Prompt="Density of points up to a 1000")
get_number = GetNumber(
    Slider(0.39, range=0.01..0.99),
    AtLeast=1,
    AtMost=1,
    Maximum=1.797693135e+308,
    Minimum=-1.797693135e+308,
    Prompt="Percentage of openings")
pt_2 = ConstructPoint(XCoordinate=0, YCoordinate=0, ZCoordinate=0)
box = Box2Pt(PointA=pt_2, PointB=get_point, Plane=PlaneXY(0, 0, 0))
popgeo = PopulateGeometry(Geometry=box, Count=get_integer, Seed=1)
voronoi³ = Voronoi3D(Points=popgeo)  # -> Cells, Boundary
mesh = MeshBrep(
    Brep=voronoi³.Cells,
    Settings={GridMaxCount=0, GridMinCount=16, JaggedSeams=False, MaxEdgeLength=0, MinEdgeLength=0.0001, MinTolerance=0, Refine=True, RefineAngle=0, RelativeTolerance=0.65, SimplePlanes=True, Tolerance=0})  # -> flatten(Mesh)
number_slider = Slider(2, range=1..3)
randomsplit = RandomSplitList(MasterList=mesh, Seed=2, Split=get_number)  # -> ListA, ListB
wbframe = WeaverbirdsPictureFrame(MeshPolylines=randomsplit.ListB, Distance=Slider(2.46, range=0.01..10), InsetType=0)
preview = CustomPreview(Geometry=[randomsplit.ListA, wbframe], Material=ColourSwatch(SwatchColor=RGB(184, 184, 184)))
context_bake = ContextBake(Geometry=[wbframe, randomsplit.ListA])
